# Grasshopper definition kinect.gh (Grasshopper 1.0.5)
# plug-ins: Firefly.Kinect.V2

timer = Timer(TimerInterval=1000, Target=kinect_v2_skeleton_tracker)
kinect_v2_skeleton_tracker = KinectV2SkeletonTracker(StartSkeletonTracker=Toggle(False))  # -> Joints, JointIDs, Bones
scale = Scale(Geometry=kinect_v2_skeleton_tracker.Joints, Center=Point(0, 0, 0), Factor=1000)  # -> Geometry, Transform
scale_2 = Scale(Geometry=kinect_v2_skeleton_tracker.Bones, Center=Point(0, 0, 0), Factor=1000)  # -> Geometry, Transform

hand = ListItem(List=scale.Geometry, Index=11, Wrap=True)
handtip = ListItem(List=scale.Geometry, Index=23, Wrap=True)
thumb = ListItem(List=scale.Geometry, Index=24, Wrap=True)

distance = Distance(PointA=hand, PointB=thumb)
distance_2 = Distance(PointA=hand, PointB=handtip)
distance_3 = Distance(PointA=thumb, PointB=handtip)

addition = Addition(A=distance_3, B=distance_2, C=distance)
smaller_than = SmallerThan(FirstNumber=addition, SecondNumber=185)  # -> SmallerThan, OrEqualTo
average = Average(Input=[hand, handtip, thumb])
data_recorder = DataRecorder(average, DataLimit=-10, RecordData=True)
clean_tree = CleanTree(RemoveNulls=True, RemoveInvalid=True, RemoveEmpty=False, Tree=data_recorder)
data_recorder_2 = DataRecorder(smaller_than.SmallerThan, DataLimit=-10, RecordData=True)
cull_pattern = CullPattern(List=clean_tree, CullPattern=data_recorder_2)
interpolate = Interpolate(Vertices=cull_pattern, Degree=1, Periodic=False, KnotStyle=0)  # -> Curve, Length, Domain
thumb_2 = ListItem(List=scale.Geometry, Index=20, Wrap=True)
thumb_3 = ListItem(List=scale.Geometry, Index=0, Wrap=True)
curve_closest_point = CurveClosestPoint(Point=cull_pattern, Curve=interpolate.Curve)  # -> Point, Parameter, Distance
line = Line(StartPoint=thumb_2, EndPoint=thumb_3)
shatter = Shatter(Curve=interpolate.Curve, Parameters=curve_closest_point.Parameter)
thumb_4 = ListItem(List=scale.Geometry, Index=21, Wrap=True)
length = Length(Curve=shatter)
curve_closest_point_2 = CurveClosestPoint(Point=thumb_4, Curve=line)  # -> Point, Parameter, Distance
smaller_than_2 = SmallerThan(FirstNumber=length, SecondNumber=170)  # -> SmallerThan, OrEqualTo
distance_4 = Distance(PointA=curve_closest_point_2.Point, PointB=thumb_3)
cull_pattern_2 = CullPattern(List=shatter, CullPattern=smaller_than_2.SmallerThan)
join_curves = JoinCurves(Curves=cull_pattern_2, Preserve=False)
panel = Panel(distance_4)
divide_curve = DivideCurve(Curve=join_curves, Count=4, Kinks=False)  # -> Points, Tangents, Parameters
number_slider = Slider(100, range=0..100)
interpolate_2 = Interpolate(Vertices=divide_curve.Points, Degree=3, Periodic=False, KnotStyle=0)  # -> Curve, Length, Domain
colour_rgb = ColourRGB(Alpha=160, Red=30, Green=240, Blue=240)
pipe = Pipe(Curve=interpolate_2.Curve, Radius=panel, Caps=1)  # disabled
custom_preview = CustomPreview(Geometry=pipe, Material=colour_rgb)
sort_list = SortList(Keys=flatten(interpolate_2.Length))  # -> Keys, ValuesValuesA
length_2 = Length(Curve=interpolate_2.Curve)
reverse_list = ReverseList(List=sort_list.Keys)
list_item = ListItem(List=reverse_list, Index=3, Wrap=True)
larger_than = LargerThan(FirstNumber=length_2, SecondNumber=list_item)  # -> LargerThan, OrEqualTo
cull_pattern_3 = CullPattern(List=interpolate_2.Curve, CullPattern=larger_than.LargerThan)
colour_rgb_2 = ColourRGB(Alpha=cull_pattern_3, Red=20, Green=240, Blue=20)
divide_curve_2 = DivideCurve(Curve=flatten(cull_pattern_3), Count=3, Kinks=False)  # -> Points, Tangents, Parameters
custom_preview_2 = CustomPreview(Material=colour_rgb_2)
point = Point(divide_curve_2.Points)
box = Box({Plane=PlaneXY(-2000, 0, -2000), X=Domain(0, 4000), Y=Domain(0, 4000), Z=Domain(0, 4000)})
division = Division(A=panel, B=2500)
subtraction = Subtraction(A=Slider(1, range=0..1), B=division)
pcharge = PointCharge(Point=point, Charge=1, Decay=2, Bounds=box)
wires = BrepWireframe(Brep=box, Density=-1)
c_script = CSharpScript(box=box, unitLength=400, fields=flatten(pcharge), outputPoints=False)  # -> out, flatten(Points), Values, XYZres; inputs box: Box, unitLength: Double, x: Int32, y: Int32, z: Int32, fields: list, outputPoints: Boolean
# ---------- c_script: C# ----------
    if(!box.IsValid)return;
    GH_Field field = new GH_Field();
    foreach(object f in fields)
    {
      foreach(IGH_FieldElement fe in (List<IGH_FieldElement>) f)
      {
        field.Elements.Add(fe);
      }
    }


    int[] range = new int[3]{0,0,0};
    if (unitLength > 0)
    {
      range[0] = (int) (box.X.Length / unitLength);
      range[1] = (int) (box.Y.Length / unitLength);
      range[2] = (int) (box.Z.Length / unitLength);
      if (range[0] < 2 || range[1] < 2 || range[2] < 2)
      {
        this.Component.AddRuntimeMessage(GH_RuntimeMessageLevel.Error, "length is oversize");
        return;
      }
    }
    else
    {
      range[0] = x;
      range[1] = y;
      range[2] = z;
      if (range[0] < 2 || range[1] < 2 || range[2] < 2)
      {
        this.Component.AddRuntimeMessage(GH_RuntimeMessageLevel.Error, "xyz should larger than 2");
        return;
      }
    }

    if(range[0] * range[1] * range[2] > 1000000)
    {
      if(DialogResult.Cancel == MessageBox.Show("计算单元数量超过1000000，确定继续？", "Warning", MessageBoxButtons.OKCancel))return;

    }

    List<double> values = new List<double>();

    DataTree<Point3d> points = new DataTree<Point3d>();
    for (int zi = 0;zi <= range[2];zi++)
    {
      double tz = zi / (double) range[2];
      for (int yi = 0;yi <= range[1];yi++)
      {
        double ty = yi / (double) range[1];
        for (int xi = 0;xi <= range[0];xi++)
        {
          double tx = xi / (double) range[0];
          Point3d pt = box.PointAt(tx, ty, tz);
          values.Add(field.TensorAt(pt).Length);
          if (outputPoints) points.Add(pt, new GH_Path(new int[2]{zi,yi}));
        }
      }
    }
    Points = points;
    Values = values;
    range[0]++;
    range[1]++;
    range[2]++;
    XYZres = range;
# ---------- end c_script ----------
normalization = CSharpScript(Values=c_script.Values)  # -> Valuesout; inputs Values: list of Double
# ---------- normalization: C# ----------
    if(Values.Count == 0)return;
    double Sum = 0;
    foreach(double v in Values)Sum += v;

    List<double> tempList = Values.ToList();
    tempList.Sort();

    double Max = tempList[(int) (Values.Count * 0.95)];
    double Min = tempList[(int) (Values.Count * 0.05)];
    //double Max = tempList[Values.Count-1];
    //double Min = tempList[0];

    double Mid = tempList[(int) (Values.Count / 2)];
    double Range = Max - Min;
    Mid = (Mid - Min) / Range;
    double Scale = Math.Log(0.5, Mid);

    for (int i = 0;i < Values.Count;i++)
    {
      double t = (Values[i] - Min) / Range;
      if (t < 0)t = 0;
      if (t > 1)t = 1;
      Values[i] = Math.Pow(t, Scale);
    }

    Valuesout = Values;
# ---------- end normalization ----------
c_script_2 = CSharpScript(
    InputBox=box,
    values=normalization,
    XYZres=c_script.XYZres,
    Iso=subtraction,
    Reference="C:\Users\WR\AppData\Roaming\Grasshopper\Libraries\SawapanStatica.dll")  # -> MeshOut; inputs InputBox: Box, values: list of Double, XYZres: list of Int32, Iso: Double
# ---------- c_script_2: C# ----------
    Box box = InputBox;
    if (!box.IsValid)return;
    List<double> list = values;
    int XRes = XYZres[0];
    int YRes = XYZres[1];
    int ZRes = XYZres[2];
    if (XRes < 2)return;
    if (YRes < 2)return;
    if (ZRes < 2)return;
    double iso = Iso;
    double num4 = 1.0 / ((double) XRes - 1.0);
    double num5 = 1.0 / ((double) YRes - 1.0);
    double num6 = 1.0 / ((double) ZRes - 1.0);
    Mesh mesh = new Mesh();
    double[] array = new double[8];
    C_Vector[] array2 = new C_Vector[8];
    C_Vector[] array3 = new C_Vector[15];
    int num7 = YRes * XRes;
    int num8 = 0;
    array2[0] = new C_Vector(0.0, 0.0, 0.0);
    array2[1] = new C_Vector(num4, 0.0, 0.0);
    array2[2] = new C_Vector(num4, num5, 0.0);
    array2[3] = new C_Vector(0.0, num5, 0.0);
    array2[4] = new C_Vector(0.0, 0.0, num6);
    array2[5] = new C_Vector(num4, 0.0, num6);
    array2[6] = new C_Vector(num4, num5, num6);
    array2[7] = new C_Vector(0.0, num5, num6);
    for (int i = 0; i < 8; i++)
    {
      Point3d point3d = box.PointAt(array2[i].x, array2[i].y, array2[i].z);
      point3d -= (Vector3d) box.PointAt(0.0, 0.0, 0.0);
      array2[i].Set(point3d.X, point3d.Y, point3d.Z);
    }
    for (int i = 1; i < ZRes ; i++)
    {
      for (int j = 1; j < YRes ; j++)
      {
        for (int k = 1; k < XRes; k++)
        {
          int num9 = (i - 1) * num7 + (j - 1) * XRes + (k - 1);
          array[0] = list[num9];
          array[1] = list[num9 + 1];
          array[2] = list[num9 + 1 + XRes];
          array[3] = list[num9 + XRes];
          array[4] = list[num9 + num7];
          array[5] = list[num9 + 1 + num7];
          array[6] = list[num9 + 1 + XRes + num7];
          array[7] = list[num9 + XRes + num7];
          Point3d point3d2 = box.PointAt((double) (k - 1) * num4, (double) (j - 1) * num5, (double) (i - 1) * num6);
          int faces = GetFaces(array2, array3, array, iso);

          if (faces > 0)
          {

            for (int l = 0; l < faces; l += 3)
            {
              mesh.Vertices.Add(array3[l].x + point3d2.X, array3[l].y + point3d2.Y, array3[l].z + point3d2.Z);
              mesh.Vertices.Add(array3[l + 1].x + point3d2.X, array3[l + 1].y + point3d2.Y, array3[l + 1].z + point3d2.Z);
              mesh.Vertices.Add(array3[l + 2].x + point3d2.X, array3[l + 2].y + point3d2.Y, array3[l + 2].z + point3d2.Z);
              mesh.Faces.AddFace(num8, num8 + 1, num8 + 2);
              num8 += 3;
            }
          }
        }
      }
    }
    mesh.Vertices.CombineIdentical(true, true);
    mesh.FaceNormals.ComputeFaceNormals();
    mesh.Normals.ComputeNormals();
    MeshOut = mesh;
# ---------- c_script_2: C# additional code ----------
  private struct C_Vector
  {
    public double x;

    public double y;

    public double z;

    public C_Vector(double _x, double _y, double _z)
    {
      this.x = _x;
      this.y = _y;
      this.z = _z;
    }



    public void Add(C_Vector v, double scale)
    {
      this.x += v.x * scale;
      this.y += v.y * scale;
      this.z += v.z * scale;
    }

    public static C_Vector operator -(C_Vector v1, C_Vector v2)
    {
      return new C_Vector(v1.x - v2.x, v1.y - v2.y, v1.z - v2.z);
    }

    public void Set(double _x, double _y, double _z)
    {
      this.x = _x;
      this.y = _y;
      this.z = _z;
    }

  }


  private int GetFaces(C_Vector[] corners, C_Vector[] fpoints, double[] d, double iso)
  {

    int signature = GetIntersectionSignature(d, iso);
    if (MAPV2E[signature, 0] == -1)
    {
      return 0;
    }
    int num = 0;
    while (num < 16 && MAPV2E[signature, num] != -1)
    {
      int aa = EDGEVERTICES[MAPV2E[signature, num], 0];
      int bb = EDGEVERTICES[MAPV2E[signature, num], 1];
      fpoints[num] = corners[aa];
      double scale = (d[aa] - iso) / (d[aa] - d[bb]);
      fpoints[num].Add(corners[bb] - corners[aa], scale);
      num++;
    }
    return num;
  }

  private int GetIntersectionSignature(double[] d, double iso)
  {
    int num = 0;
    for (int i = 0; i < 8; i++)
    {
      if (d[i] - iso > 0.0)
      {
        num |= VERTEXID[i];
      }
    }
    return num;
  }

  private static int[] VERTEXID = new int[]
    {
    1,
    2,
    4,
    8,
    16,
    32,
    64,
    128
    };


  private static int[,] EDGEVERTICES = new int[12, 2]
    {
    {0,1},
    {1,2},
    {2,3},
    {3,0},
    {4,5},
    {5,6},
    {6,7},
    {7,4},
    {0,4},
    {1,5},
    {2,6},
    {3,7}
    };

  private static int[,] MAPV2E = new int[256, 16]
    {
    {-1,-1,-1,-1,-1,-1,-1,-1,-1,-1,-1,-1,-1,-1,-1,-1},
    {0,8,3,-1,-1,-1,-1,-1,-1,-1,-1,-1,-1,-1,-1,-1},
    {0,1,9,-1,-1,-1,-1,-1,-1,-1,-1,-1,-1,-1,-1,-1},
    {1,8,3,9,8,1,-1,-1,-1,-1,-1,-1,-1,-1,-1,-1},
    {1,2,10,-1,-1,-1,-1,-1,-1,-1,-1,-1,-1,-1,-1,-1},
    {0,8,3,1,2,10,-1,-1,-1,-1,-1,-1,-1,-1,-1,-1},
    {9,2,10,0,2,9,-1,-1,-1,-1,-1,-1,-1,-1,-1,-1},
    {2,8,3,2,10,8,10,9,8,-1,-1,-1,-1,-1,-1,-1},
    {3,11,2,-1,-1,-1,-1,-1,-1,-1,-1,-1,-1,-1,-1,-1},
    {0,11,2,8,11,0,-1,-1,-1,-1,-1,-1,-1,-1,-1,-1},
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    };
# ---------- end c_script_2 ----------
timer_2 = Timer(TimerInterval=1000, Target=[colour_rgb_4, custom_preview_4])
colour_rgb_3 = ColourRGB(Alpha=100, Red=180, Green=200, Blue=240)
msmooth = SmoothMesh(Mesh=c_script_2, Strength=1, SkipNaked=True, Iterations=1)
colour_rgb_4 = ColourRGB(Alpha=100, Red=100, Green=100, Blue=240)
custom_preview_3 = CustomPreview(Geometry=wires, Material=colour_rgb_3)
custom_preview_4 = CustomPreview(Geometry=msmooth, Material=colour_rgb_4)
